# Grasshopper definition Fuso.gh (Grasshopper 1.0.7)
# plug-ins: HelixGH

comprimento_l = Slider(151, range=0..500)

# ---- group: Zona de Dosagem (ZD)
multiplication = Multiplication(A=comprimento_l, B="0.3")

# ---- group: Zona de Alimentação (ZA)
multiplication_2 = Multiplication(A=comprimento_l, B="0.3")

# ---- group: Zona de Compressão (ZC)
multiplication_3 = Multiplication(A=comprimento_l, B="0.4")

# ---- group: Diametro
l_20 = Panel("20")
# GNU nano 7.2                                    Fuso.md                                             | **Parte** | **Tamanho** | **Profundidade** |
# |---|---|---|
# | Comprimento (L) | 20xD | - |
# | Diametro (D) | L/20 | - |
# | Passo da Rosca (P) | P=D | - |
# | Zona de Aliemntação (ZA) | Lx0.3 | Dx0.12 |
# | Zona de Compressão (ZC) | Lx0.4 | |
# | Zona de Dosagem (ZD) | Lx0.3 | Dx(0.03 ~ 0.05) |
# | Angulo | 17º ~ 20º | - |
division = Division(A=comprimento_l, B=l_20)

# ---- group: profundidade ZA
multiplication_4 = Multiplication(A=division, B="0.12")

# ----
division_2 = Division(A=comprimento_l, B=division)
paso_da_rosca_p = Data(division)
helix_curve = HelixCurve(Diameter=division, Taper=1, Infinite="true", Pitch=paso_da_rosca_p, Turns=division_2, Reverse=False)  # -> Helix, Height

negative = Negative(Value=multiplication_4)
xz_plane = XZPlane(Origin=Point(0, 0, 0))
yz_plane = YZPlane(Origin=Point(0, 0, 0))
unit_x = UnitX(Factor=negative)
point = Point(yz_plane)
point_2 = Point(xz_plane)
move = Move(Geometry=point, Motion=unit_x)  # -> Geometry, Transform
line = Line(StartPoint=point_2, EndPoint=move.Geometry)
rotate = Rotate(Geometry=line, Angle=-0.349, Plane=xz_plane)  # -> Geometry, Transform
mirror_curve = MirrorCurve(Geometry=rotate.Geometry, Curve=line, Tangent=True)
join_curves = JoinCurves(Curves=[mirror_curve, rotate.Geometry], Preserve=False)
fillet = Fillet(Curve=join_curves, Radius=Slider(0.11, range=0.01..1))

division_3 = Division(A=division, B=2)
circle = Circle(Plane=PlaneXY(0, 0, 0), Radius=division_3)
unit_z = UnitZ(Factor=comprimento_l)
surface = Surface(circle)
extrude = Extrude(Base=surface, Direction=unit_z)  # -> flatten(Extrusion)
